# Grasshopper definition from_building_solids.gh (Grasshopper 1.0.7)

# ----
# Full Bldg Small Office ProgramType
panel = Panel("""2013::LargeOffice::ClosedOffice
2013::LargeOffice::Conference
2013::LargeOffice::Corridor
2013::LargeOffice::OpenOffice
2013::LargeOffice::Restroom
2013::LargeOffice::Storage""")
panel_2 = Panel("""0.15
0.15
0.2
0.4
0.05
0.05""")
blendprograms = HBBlendProgramTypes(name="LargeOfficeBuilding", programs=panel, ratios=panel_2)  # -> program; plug-in component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

# ----
# Construction Set
bldg_vintage = Dragonfly_BldgAge({"ASHRAE 90.1 2013  |  IECC 2015": "2013", "ASHRAE 90.1 2010  |  IECC 2012": "2010", "ASHRAE 90.1 2007  |  IECC 2009": "2007", "ASHRAE 90.1 2004  |  IECC 2006": "2004", "1980-2004 (CBECS)": "1980_2004", "Pre-1980 (CBECS)": "pre_1980"}, selected="ASHRAE 90.1 2013  |  IECC 2015")
constr_type = Dragonfly_BldgAge({"SteelFramed", "WoodFramed", "Mass", "Metal Building"}, selected="SteelFramed")
climate_zone = Dragonfly_BldgAge({"1 - Very Hot": "1", "2 - Hot": "2", "3 - Warm": "3", "4 - Mixed": "4", "5 - Cool": "5", "6 - Cold": "6", "7 - Very Cold": "7", "8 - Subarctic": "8"}, selected="5 - Cool")
searchconstrset = HBSearchConstructionSets(climate_zone=climate_zone, vintage=bldg_vintage, constr_type=constr_type)  # -> constr_set; plug-in component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

officesolids = Geometry([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])
panel_3 = Panel("""1@5
2@4
@3""")
panel_4 = Panel("""@4
@3""")

buildingsolid = DFBuildingFromSolid(
    bldg_geo=flatten(officesolids),
    floor_to_floor=panel_3,
    name="OfficeBldg",
    program=blendprograms,
    constr_set=searchconstrset,
    run=Toggle(True))  # -> report, buildings; plug-in component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
decnstrdf = DFDeconstructObject(df_obj=buildingsolid.buildings)  # -> stories, room2ds; plug-in component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

wires = BrepWireframe(Brep=officesolids, Density=-1)
decnstrdfall = DFDeconstructAllObject()  # -> all_stories, all_room2ds; plug-in component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

# ---- group: properties for ground floor retail
item = ListItem(List=decnstrdf.stories, Index="0", Wrap=True)
reassignprop = DFReassignProperties(df_obj=item, program="pre_1980::StripMall::Type 1")  # -> df_obj; plug-in component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
simpleratio = DFSimpleGlazingRatio(ratio="0.65")  # -> glz_par; plug-in component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
applyfacadepar = DFApplyFacadeParameters(df_obj=reassignprop, glz_par=simpleratio)  # -> report, df_obj; plug-in component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

# ---- group: properties for above-ground office
cull_i = CullIndex(List=decnstrdf.stories, Indices="0", Wrap=True)
simpleratio_2 = DFSimpleGlazingRatio(ratio="0.4")  # -> glz_par; plug-in component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
applyfacadepar_2 = DFApplyFacadeParameters(df_obj=cull_i, glz_par=simpleratio_2)  # -> report, df_obj; plug-in component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

# ----
txt = Text(buildingsolid.buildings)
split = TextSplit(Text=txt, Separators=":")
item_2 = ListItem(List=split, Index="-1", Wrap=True)  # -> simplify(Item)

stories = Data(simplify(applyfacadepar_2.df_obj))
stories_2 = Data(simplify(applyfacadepar.df_obj))
stories_3 = Data(simplify([stories, stories_2]))
buildingstories = DFBuildingFromStories(stories=stories_3, name=item_2, constr_set=searchconstrset)  # -> report, building; plug-in component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
contextshade = Geometry([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])
commercialbldgs = Data(flatten(buildingstories.building))
shade = HBShade(geo=contextshade)  # -> report, shades; plug-in component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

# ----
# Simulation Parameters
toggle = BooleanToggle(True)
simoutput = HBSimulationOutput(zone_energy_use=toggle, summary_reports="AllSummary")  # -> report, sim_output; plug-in component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
shadowcalc = HBShadowCalculation(solar_dist="FullExteriorWithReflections")  # -> shadow_calc; plug-in component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
simpar = HBSimulationParameter(output=simoutput.sim_output, timestep=6, shadow_calc=shadowcalc)  # -> sim_par; plug-in component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

# ----
# Download EPW File
panel_5 = Panel("https://www.energyplus.net/weather-download/north_and_central_america_wmo_region_4/USA/MA/USA_MA_Boston-Logan.Intl.AP.725090_TMY3/all")
downloadweather = LadybugPlus_DownloadWeather(weather_URL=panel_5)  # -> epw_file, stat_file, ddy_file; plug-in component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

toggle_2 = BooleanToggle(False)

residentialsolids = Geometry([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])
simpleratio_3 = DFSimpleGlazingRatio(ratio="0.25")  # -> glz_par; plug-in component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

wires_2 = BrepWireframe(Brep=residentialsolids, Density=-1)
buildingsolid_2 = DFBuildingFromSolid(
    bldg_geo=flatten(residentialsolids),
    floor_to_floor=panel_4,
    name="ResidentialBldg",
    program="2013::MidriseApartment::Apartment",
    constr_set=searchconstrset,
    run=Toggle(True))  # -> report, buildings; plug-in component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

applyfacadepar_3 = DFApplyFacadeParameters(df_obj=flatten(buildingsolid_2.buildings), glz_par=simpleratio_3)  # -> report, df_obj; plug-in component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

all_buildings = Data(flatten([commercialbldgs, applyfacadepar_3.df_obj]))
buildingtohoneybee = DFBuildingToHoneybee(
    buildings=flatten(all_buildings),
    context=flatten(shade.shades),
    use_multiplier=Toggle(True),
    shade_dist="100",
    run=Toggle(True))  # -> report, models; plug-in component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
item_3 = ListItem(List=buildingtohoneybee.models, Index=Slider(1, range=0..10), Wrap=True)

separatemodel = HBSeparateModel()  # -> rooms, faces, apertures, doors, shades; plug-in component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
vizall = HBVizualizeAll(hb_obj=flatten(item_3))  # -> geo; plug-in component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

modeltoidf = HBModelToIDF(
    model=item_3,
    epw_file=downloadweather.epw_file,
    sim_par=simpar,
    folder="C:\Users\chris\honeybee\district_model",
    write=toggle_2,
    run=toggle_2)  # -> report, idf, sql, eio, rdd, html; plug-in component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
